# Grasshopper definition RSI_EthernetTorque.gh (Grasshopper 0.9.64)
# plug-ins: gHowl, Firefly

# ---- group: UDP Data In
# RSI  UDP Communication
ip_address = Panel("192.168.2.106")
port_number = Panel("49152")
udp = UDPReceiver(Address=ip_address, Port=port_number, Pattern=0)  # -> Info, Data

# ---- group: UPD Data Parse
xml = XmlParser(Path=udp.Data)  # -> Elements, Values, AttributeNames, AttributeValues, CData
xml_elements = Panel(xml.Elements)
xml_attributes = Panel(xml.AttributeNames)
xml_values = Panel(xml.AttributeValues)

# ---- group: Generate Data String
# Data Logging via CSV File
panel = Panel("{0;0}")
branch = TreeBranch(Tree=xml.AttributeValues, Path=panel, MaintainPaths=True)
branch_2 = TreeBranch(Tree=xml.AttributeValues, Path="{0;0;0}", MaintainPaths=True)
join = TextJoin(Text=flatten([branch, branch_2]), Join=",")

# ---- group: Isolate Values
data = Data(branch)
# Drawing of Robot Position in Rhino (not necessary, but fun!)
item_x = ListItem(List=data, Index=0, Wrap=True)
item_y = ListItem(List=data, Index=1, Wrap=True)
item_z = ListItem(List=data, Index=2, Wrap=True)
item_a = ListItem(List=data, Index=3, Wrap=True)
item_b = ListItem(List=data, Index=4, Wrap=True)
item_c = ListItem(List=data, Index=5, Wrap=True)

# ---- group: Draw Origin
pt = ConstructPoint(XCoordinate=item_x, YCoordinate=item_y, ZCoordinate=item_z)
pl = ConstructPlane(Origin=pt, XAxis=Vector(1, 0, 0), YAxis=Vector(0, 1, 0))
rot3d_a = Rotate3D(Geometry=pl, Angle=expr("Rad(A)", item_a), Center=pl, Axis=Vector(0, 0, 1))  # -> Geometry, Transform
deplane = DeconstructPlane(Plane=rot3d_a.Geometry)  # -> Origin, XAxis, YAxis, ZAxis
rot3d_b = Rotate3D(Geometry=rot3d_a.Geometry, Angle=expr("Rad(A)", item_b), Center=deplane.Origin, Axis=deplane.YAxis)  # -> Geometry, Transform
deplane_2 = DeconstructPlane(Plane=rot3d_b.Geometry)  # -> Origin, XAxis, YAxis, ZAxis
rot3d_c = Rotate3D(Geometry=rot3d_b.Geometry, Angle=expr("Rad(A)", item_c), Center=deplane_2.Origin, Axis=deplane_2.XAxis)  # -> Geometry, Transform
deplane_3 = DeconstructPlane(Plane=rot3d_c.Geometry)  # -> Origin, XAxis, YAxis, ZAxis
move = Move(Geometry=deplane_3.Origin, Motion=[deplane_3.XAxis, deplane_3.YAxis, deplane_3.ZAxis])  # -> Geometry, Transform
ln = Line(StartPoint=deplane_3.Origin, EndPoint=move.Geometry)
pos_cur = Line(ln)

# ---- group: Log & Write to CSV
data_file_location = Panel("C:\Users\willetta-admin\Desktop\Temp\GH_test\Torque\test_stream.csv")
record = BooleanToggle(True)
reset = Button()
log = DataLog(
    IncomingData=join,
    ResetLog=reset,
    StartRecording=record,
    WrapValues=False,
    RecordingLength=0,
    OptionalFilePath=data_file_location)
panel_2 = Panel(log)
